# Grasshopper definition GeneratePythonComponent.gh (Grasshopper 1.0.8)

# ----
# Generate Python 3 script with input and output
panel = Panel("""SoundPath:str:Item
TimeBins:int:Item
FreqBins:int:Item
MinFrequency:float:Item
MaxFrequency:float:Item""")
panel_2 = Panel("""P
A
B
C""")
create_python3 = CSharpScript(Generate=Button(), InputParams=panel, OutputParams=panel_2)  # -> out; inputs Generate: Boolean, InputParams: list of String, OutputParams: list of String
# ---------- create_python3: C# ----------
#r "RhinoCodePluginGH.rhp"

using System;
using System.Collections.Generic;
using System.Drawing;
using System.Linq;

using Grasshopper;
using Grasshopper.Kernel;

using Rhino.Geometry;

using RhinoCodePluginGH.Components;
using RhinoCodePluginGH.Parameters;


public class Script_Instance : GH_ScriptInstance
{
    private bool _previousGenerate = false;


    // ========================================================================
    // DATA
    // ========================================================================

    private class InputSpec
    {
        public int SourceIndex;
        public string Name;
        public string TypeHint;
        public GH_ParamAccess Access;

        public InputSpec(
            int sourceIndex,
            string name,
            string typeHint,
            GH_ParamAccess access)
        {
            SourceIndex = sourceIndex;
            Name = name;
            TypeHint = typeHint;
            Access = access;
        }
    }


    private class OutputSpec
    {
        public int SourceIndex;
        public string Name;

        public OutputSpec(
            int sourceIndex,
            string name)
        {
            SourceIndex = sourceIndex;
            Name = name;
        }
    }


    // ========================================================================
    // TYPE-HINT ALIASES
    //
    // Every user-facing spelling maps to one canonical internal name.
    // Matching is case-insensitive.
    // ========================================================================

    private static readonly Dictionary<string, string> HintAliases =
        new Dictionary<string, string>(
            StringComparer.OrdinalIgnoreCase)
        {
            // No type hint
            { "object", "object" },
            { "none", "object" },


            // Basic Python types
            { "bool", "bool" },
            { "boolean", "bool" },

            { "int", "int" },
            { "integer", "int" },

            { "float", "float" },
            { "double", "float" },
            { "number", "float" },

            { "str", "str" },
            { "string", "str" },
            { "text", "str" },


            // .NET
            { "Guid", "Guid" },
            { "DateTime", "DateTime" },
            { "Complex", "Complex" },
            { "Color", "Color" },


            // Points / vectors / frames
            { "Point3d", "Point3d" },
            { "point", "Point3d" },

            { "Vector3d", "Vector3d" },
            { "vector", "Vector3d" },

            { "Plane", "Plane" },


            // Domains
            { "Interval", "Interval" },
            { "UVInterval", "UVInterval" },


            // Curves
            { "Line", "Line" },
            { "Circle", "Circle" },
            { "Arc", "Arc" },
            { "Polyline", "Polyline" },
            { "Rectangle3d", "Rectangle3d" },
            { "Curve", "Curve" },


            // Other geometry / maths
            { "Box", "Box" },
            { "Transform", "Transform" },
            { "Point3dList", "Point3dList" },


            // Geometry
            { "Mesh", "Mesh" },
            { "Surface", "Surface" },
            { "Extrusion", "Extrusion" },
            { "SubD", "SubD" },
            { "Brep", "Brep" },
            { "PointCloud", "PointCloud" },
            { "GeometryBase", "GeometryBase" },


            // Annotation
            { "Hatch", "Hatch" },
            { "TextDot", "TextDot" },
            { "TextEntity", "TextEntity" },
            { "Leader", "Leader" }
        };


    // ========================================================================
    // NORMAL TYPE HINTS
    //
    // These are applied using the actual .NET/Rhino type.
    //
    // Rhino's Python component then chooses the correct Python converter.
    // ========================================================================

    private static readonly Dictionary<string, Type> HintTypes =
        new Dictionary<string, Type>(
            StringComparer.OrdinalIgnoreCase)
        {
            // Basic
            { "bool", typeof(bool) },
            { "int", typeof(int) },
            { "float", typeof(double) },
            { "str", typeof(string) },


            // .NET
            { "Guid", typeof(Guid) },
            { "DateTime", typeof(DateTime) },
            { "Complex", typeof(System.Numerics.Complex) },
            { "Color", typeof(System.Drawing.Color) },


            // Points / vectors / frames
            { "Point3d", typeof(Point3d) },
            { "Vector3d", typeof(Vector3d) },
            { "Plane", typeof(Plane) },


            // Domains
            { "Interval", typeof(Interval) },

            // UVInterval is a Grasshopper type, not Rhino.Geometry.
            { "UVInterval", typeof(Grasshopper.Kernel.Types.UVInterval) },


            // Curves
            { "Line", typeof(Line) },
            { "Circle", typeof(Circle) },
            { "Arc", typeof(Arc) },
            { "Polyline", typeof(Polyline) },
            { "Rectangle3d", typeof(Rectangle3d) },
            { "Curve", typeof(Curve) },


            // Other
            { "Box", typeof(Box) },
            { "Transform", typeof(Transform) },


            // Geometry
            { "Mesh", typeof(Mesh) },
            { "Surface", typeof(Surface) },
            { "Extrusion", typeof(Extrusion) },
            { "SubD", typeof(SubD) },
            { "Brep", typeof(Brep) },
            { "PointCloud", typeof(PointCloud) },
            { "GeometryBase", typeof(GeometryBase) },


            // Annotation
            { "Hatch", typeof(Hatch) },
            { "TextDot", typeof(TextDot) },
            { "TextEntity", typeof(TextEntity) },
            { "Leader", typeof(Leader) }
        };


    // Some converters are better selected using their converter name.
    private static readonly Dictionary<string, string> NamedHints =
        new Dictionary<string, string>(
            StringComparer.OrdinalIgnoreCase)
        {
            { "Point3dList", "Point3dList" }
        };


    // ========================================================================
    // PYTHON RESERVED WORDS
    // ========================================================================

    private static readonly HashSet<string> PythonKeywords =
        new HashSet<string>(StringComparer.Ordinal)
        {
            "False",
            "None",
            "True",

            "and",
            "as",
            "assert",
            "async",
            "await",

            "break",

            "class",
            "continue",

            "def",
            "del",

            "elif",
            "else",
            "except",

            "finally",
            "for",
            "from",

            "global",

            "if",
            "import",
            "in",
            "is",

            "lambda",

            "nonlocal",
            "not",

            "or",

            "pass",

            "raise",
            "return",

            "try",

            "while",
            "with",

            "yield"
        };


    // ========================================================================
    // MAIN
    // ========================================================================

    private void RunScript(
		bool Generate,
		List<string> InputParams,
		List<string> OutputParams)
    {
        // Only generate on:
        //
        // false -> true

        bool risingEdge =
            Generate && !_previousGenerate;


        _previousGenerate =
            Generate;


        if (!risingEdge)
            return;


        var errors =
            new List<string>();


        var inputs =
            ParseInputs(
                InputParams ?? new List<string>(),
                errors);


        var outputs =
            ParseOutputs(
                OutputParams ?? new List<string>(),
                errors);


        ValidateDuplicates(
            inputs,
            outputs,
            errors);


        // --------------------------------------------------------------------
        // VALIDATE EVERYTHING FIRST
        // --------------------------------------------------------------------

        if (errors.Count > 0)
        {
            Component.AddRuntimeMessage(
                GH_RuntimeMessageLevel.Error,

                "Generation failed:\n\n- " +
                string.Join(
                    "\n- ",
                    errors));

            return;
        }


        GH_Document doc =
            Component.OnPingDocument();


        if (doc == null)
        {
            Component.AddRuntimeMessage(
                GH_RuntimeMessageLevel.Error,
                "Generation failed: Grasshopper document was not found.");

            return;
        }


        // Position new Python component to the right.
        float x =
            Component.Attributes.Bounds.Right + 180.0f;

        float y =
            Component.Attributes.Pivot.Y;


        PointF position =
            new PointF(
                x,
                y);


        // Modify GH document after current solution.
        doc.ScheduleSolution(
            1,
            d =>
            {
                try
                {
                    CreatePythonComponent(
                        d,
                        inputs,
                        outputs,
                        position);
                }
                catch (Exception ex)
                {
                    Component.AddRuntimeMessage(
                        GH_RuntimeMessageLevel.Error,

                        "Python component generation failed:\n\n" +
                        ex.Message);
                }
            });
    }


    // ========================================================================
    // INPUT PARSING
    // ========================================================================

    private List<InputSpec> ParseInputs(
        List<string> values,
        List<string> errors)
    {
        var result =
            new List<InputSpec>();


        for (int i = 0; i < values.Count; i++)
        {
            int itemNumber =
                i + 1;


            string location =
                $"InputParams item {itemNumber}";


            string raw =
                values[i];


            if (string.IsNullOrWhiteSpace(raw))
            {
                errors.Add(
                    $"{location}: definition is empty.");

                continue;
            }


            string[] parts =
                raw.Split(':');


            if (parts.Length > 3)
            {
                errors.Add(
                    $"{location}: invalid format. " +
                    "Expected Name, Name : TypeHint, " +
                    "or Name : TypeHint : Access.");

                continue;
            }


            // ----------------------------------------------------------------
            // NAME
            // ----------------------------------------------------------------

            string name =
                parts[0].Trim();


            ValidateName(
                name,
                location,
                errors);


            // ----------------------------------------------------------------
            // TYPE HINT
            //
            // Default:
            //
            // object / No Type Hint
            // ----------------------------------------------------------------

            string typeHint =
                "object";


            if (parts.Length >= 2)
            {
                string requested =
                    parts[1].Trim();


                if (requested.Length == 0)
                {
                    errors.Add(
                        $"{location}: type hint is empty.");
                }
                else
                {
                    string canonical;


                    if (
                        HintAliases.TryGetValue(
                            requested,
                            out canonical))
                    {
                        typeHint =
                            canonical;
                    }
                    else
                    {
                        errors.Add(
                            $"{location}: invalid type hint " +
                            $"'{requested}'.");
                    }
                }
            }


            // ----------------------------------------------------------------
            // ACCESS
            //
            // Default = item
            // ----------------------------------------------------------------

            GH_ParamAccess access =
                GH_ParamAccess.item;


            if (parts.Length == 3)
            {
                string requested =
                    parts[2].Trim();


                if (
                    requested.Equals(
                        "item",
                        StringComparison.OrdinalIgnoreCase))
                {
                    access =
                        GH_ParamAccess.item;
                }
                else if (
                    requested.Equals(
                        "list",
                        StringComparison.OrdinalIgnoreCase))
                {
                    access =
                        GH_ParamAccess.list;
                }
                else if (
                    requested.Equals(
                        "tree",
                        StringComparison.OrdinalIgnoreCase))
                {
                    access =
                        GH_ParamAccess.tree;
                }
                else
                {
                    errors.Add(
                        $"{location}: invalid access " +
                        $"'{requested}'. " +
                        "Expected item, list, or tree.");
                }
            }


            result.Add(
                new InputSpec(
                    itemNumber,
                    name,
                    typeHint,
                    access));
        }


        return result;
    }


    // ========================================================================
    // OUTPUT PARSING
    // ========================================================================

    private List<OutputSpec> ParseOutputs(
        List<string> values,
        List<string> errors)
    {
        var result =
            new List<OutputSpec>();


        for (int i = 0; i < values.Count; i++)
        {
            int itemNumber =
                i + 1;


            string location =
                $"OutputParams item {itemNumber}";


            string raw =
                values[i];


            if (string.IsNullOrWhiteSpace(raw))
            {
                errors.Add(
                    $"{location}: name is empty.");

                continue;
            }


            // Outputs only accept:
            //
            // Name

            if (raw.Contains(":"))
            {
                errors.Add(
                    $"{location}: output parameters only accept a name.");

                continue;
            }


            string name =
                raw.Trim();


            ValidateName(
                name,
                location,
                errors);


            result.Add(
                new OutputSpec(
                    itemNumber,
                    name));
        }


        return result;
    }


    // ========================================================================
    // NAME VALIDATION
    // ========================================================================

    private void ValidateName(
        string name,
        string location,
        List<string> errors)
    {
        if (string.IsNullOrEmpty(name))
        {
            errors.Add(
                $"{location}: parameter name is empty.");

            return;
        }


        // User requirement:
        // absolutely no whitespace inside a parameter name.

        if (name.Any(char.IsWhiteSpace))
        {
            errors.Add(
                $"{location}: parameter name " +
                $"'{name}' contains spaces.");

            return;
        }


        if (!IsValidIdentifier(name))
        {
            errors.Add(
                $"{location}: parameter name " +
                $"'{name}' is not a valid Python variable name.");

            return;
        }


        if (PythonKeywords.Contains(name))
        {
            errors.Add(
                $"{location}: parameter name " +
                $"'{name}' is a Python keyword.");
        }
    }


    private bool IsValidIdentifier(
        string name)
    {
        if (string.IsNullOrEmpty(name))
            return false;


        char first =
            name[0];


        if (
            !char.IsLetter(first) &&
            first != '_')
        {
            return false;
        }


        for (int i = 1; i < name.Length; i++)
        {
            char c =
                name[i];


            if (
                !char.IsLetterOrDigit(c) &&
                c != '_')
            {
                return false;
            }
        }


        return true;
    }


    // ========================================================================
    // DUPLICATE VALIDATION
    // ========================================================================

    private void ValidateDuplicates(
        List<InputSpec> inputs,
        List<OutputSpec> outputs,
        List<string> errors)
    {
        var seen =
            new Dictionary<string, string>(
                StringComparer.Ordinal);


        foreach (
            InputSpec input
            in inputs)
        {
            string location =
                $"InputParams item {input.SourceIndex}";


            CheckDuplicate(
                input.Name,
                location,
                seen,
                errors);
        }


        foreach (
            OutputSpec output
            in outputs)
        {
            string location =
                $"OutputParams item {output.SourceIndex}";


            CheckDuplicate(
                output.Name,
                location,
                seen,
                errors);
        }
    }


    private void CheckDuplicate(
        string name,
        string location,
        Dictionary<string, string> seen,
        List<string> errors)
    {
        if (string.IsNullOrEmpty(name))
            return;


        string firstLocation;


        if (
            seen.TryGetValue(
                name,
                out firstLocation))
        {
            errors.Add(
                $"{location}: duplicate name '{name}' " +
                $"(already used at {firstLocation}).");
        }
        else
        {
            seen[name] =
                location;
        }
    }


    // ========================================================================
    // APPLY TYPE HINT
    // ========================================================================

    private void ApplyTypeHint(
        ScriptVariableParam parameter,
        string canonicalHint)
    {
        // object = No Type Hint

        if (
            string.IsNullOrEmpty(canonicalHint) ||
            canonicalHint.Equals(
                "object",
                StringComparison.OrdinalIgnoreCase))
        {
            return;
        }


        // --------------------------------------------------------------------
        // NORMAL .NET / RHINO TYPE
        // --------------------------------------------------------------------

        Type clrType;


        if (
            HintTypes.TryGetValue(
                canonicalHint,
                out clrType))
        {
            parameter.TypeHints.Select(
                clrType);

            return;
        }


        // --------------------------------------------------------------------
        // NAMED CONVERTER
        // --------------------------------------------------------------------

        string namedHint;


        if (
            NamedHints.TryGetValue(
                canonicalHint,
                out namedHint))
        {
            parameter.TypeHints.Select(
                namedHint);

            return;
        }


        throw new Exception(
            $"Could not apply type hint " +
            $"'{canonicalHint}'.");
    }


    // ========================================================================
    // CREATE PYTHON COMPONENT
    // ========================================================================

    private void CreatePythonComponent(
        GH_Document doc,
        List<InputSpec> inputs,
        List<OutputSpec> outputs,
        PointF position)
    {
        // --------------------------------------------------------------------
        // CREATE PYTHON 3 COMPONENT
        // --------------------------------------------------------------------

        Python3Component python =
            Python3Component.Create(
                "GeneratedPython");


        // Remove every default parameter.
        python.Params.Clear(true);


        // Do not create the standard "out" output.
        python.UsingStandardOutputParam =
            false;


        // ====================================================================
        // INPUTS
        // ====================================================================

        foreach (
            InputSpec spec
            in inputs)
        {
            var parameter =
                new ScriptVariableParam(
                    spec.Name)
                {
                    PrettyName =
                        spec.Name,

                    Optional =
                        true,

                    Access =
                        spec.Access,

                    AllowTreeAccess =
                        true
                };


            ApplyTypeHint(
                parameter,
                spec.TypeHint);


            parameter.CreateAttributes();


            python.Params.RegisterInputParam(
                parameter);
        }


        // ====================================================================
        // OUTPUTS
        // ====================================================================

        foreach (
            OutputSpec spec
            in outputs)
        {
            var parameter =
                new ScriptVariableParam(
                    spec.Name)
                {
                    PrettyName =
                        spec.Name
                };


            // Python outputs deliberately receive NO Type Hint.
            parameter.CreateAttributes();


            python.Params.RegisterOutputParam(
                parameter);
        }


        // Required after modifying script component parameters.
        python.VariableParameterMaintenance();


        // Ask Rhino itself to synchronize the Python RunScript signature
        // with the parameters we have just created.
        //
        // For example:
        //
        // typeof(string) -> str
        // typeof(double) -> float

        python.SetParametersToScript();


        // --------------------------------------------------------------------
        // POSITION
        // --------------------------------------------------------------------

        python.CreateAttributes();


        python.Attributes.Pivot =
            position;


        // --------------------------------------------------------------------
        // ADD TO DOCUMENT
        //
        // This happens LAST so a failure above does not leave a half-created
        // component on the canvas.
        // --------------------------------------------------------------------

        doc.AddObject(
            python,
            false);


        python.ExpireSolution(
            false);


        Grasshopper.Instances
            .ActiveCanvas?
            .Refresh();
    }
}
# ---------- end create_python3 ----------
