# Grasshopper definition BIG_Seprentine_Pavillion_nativeGrasshopper.gh (Grasshopper 1.0.8)

number_slider = Slider(60, range=0..100)
number_slider_2 = Slider(25, range=0..100)
series = Series(Start=0, Step="25", Count=number_slider_2)
series_2 = Series(Start=0, Step="25", Count=number_slider)
series_3 = Series(Start=0, Step="25", Count=number_slider_2)
series_4 = Series(Start=0, Step="25", Count=number_slider)
construct_point = ConstructPoint(XCoordinate=series_2, YCoordinate=0, ZCoordinate=graft(series))  # -> simplify(Point)
range = Range(Domain=Domain(0, 1), Steps=expr("x-1", number_slider_2))
construct_point_2 = ConstructPoint(XCoordinate=series_4, YCoordinate=0, ZCoordinate=graft(series_3))  # -> simplify(Point)
range_2 = Range(Domain=Domain(0, 1), Steps=expr("x-1", number_slider_2))
range_3 = Range(Domain=Domain(0, 1), Steps=expr("x-1", number_slider))
range_4 = Range(Domain=Domain(0, 1), Steps=expr("x-1", number_slider))
graph_mapper = GraphMapper(
    range,
    x0=0,
    x1=1,
    y0=0,
    y1=1,
    container_name="Bezier",
    cpx=[0, 0.7481380105, 0.3850557506, 1],
    cpy=[0.2473914027, 0.03518277407, 0.9809773564, 1])
graph_mapper_2 = GraphMapper(range_3, x0=0, x1=1, y0=0, y1=1, container_name="Sine", Equation_px=[0.7502149343, 1], Equation_py=[0.3321515322, 1])
graph_mapper_3 = GraphMapper(
    range_2,
    x0=0,
    x1=1,
    y0=0,
    y1=1,
    container_name="Bezier",
    cpx=[0, 0.8007246256, 0.2894941568, 1],
    cpy=[0, 0.0003622174263, 0.7730613351, 1])
graph_mapper_4 = GraphMapper(range_4, x0=0, x1=1, y0=0, y1=1, container_name="Sine", Equation_px=[0.5041512847, 1], Equation_py=[0.3617914915, 1])
multiplication = Multiplication(A=graph_mapper_2, B=Slider(248, range=0..1000))
multiplication_2 = Multiplication(A=multiplication, B=reverse(graft(graph_mapper)))
multiplication_3 = Multiplication(A=graph_mapper_4, B=Slider(248, range=0..1000))
multiplication_4 = Multiplication(A=multiplication_3, B=reverse(graft(graph_mapper_3)))
unit_y = UnitY(Factor=multiplication_2)
unit_y_2 = UnitY(Factor=multiplication_4)
series_5 = Series(Start=0, Step=1, Count=number_slider_2)
negative = Negative(Value=unit_y)
move = Move(Geometry=construct_point, Motion=simplify(negative))  # -> Geometry, Transform
move_2 = Move(Geometry=construct_point_2, Motion=simplify(unit_y_2))  # -> Geometry, Transform
xz_plane = XZPlane(Origin=move.Geometry)
xz_plane_2 = XZPlane(Origin=move_2.Geometry)
rectangle = Rectangle(Plane=xz_plane, XSize="25", YSize="25", Radius=0)  # -> Rectangle, Length
rectangle_2 = Rectangle(Plane=xz_plane_2, XSize="25", YSize="25", Radius=0)  # -> Rectangle, Length
panel = Panel("""0
1""")
series_6 = Series(Start=0, Step=1, Count=number_slider_2)
panel_2 = Panel("""0
1""")
shift_list = ShiftList(List=panel, Shift=graft(series_5), Wrap=True)
shift_list_2 = ShiftList(List=panel_2, Shift=graft(series_6), Wrap=True)
dispatch = Dispatch(List=multiplication_2, DispatchPattern=shift_list_2)  # -> ListA, ListB
multiplication_5 = Multiplication(A=dispatch.ListA, B=Slider(0.25, range=0..1))
dispatch_2 = Dispatch(List=rectangle_2.Rectangle, DispatchPattern=shift_list)  # -> ListA, ListB
dispatch_3 = Dispatch(List=multiplication_4, DispatchPattern=shift_list)  # -> ListA, ListB
dispatch_4 = Dispatch(List=rectangle.Rectangle, DispatchPattern=shift_list_2)  # -> ListA, ListB
addition = Addition(A=multiplication_5, B=Slider(50, range=0..100))
unit_y_3 = UnitY(Factor=addition)
multiplication_6 = Multiplication(A=dispatch_3.ListA, B=Slider(0.25, range=0..1))
addition_2 = Addition(A=multiplication_6, B=Slider(50, range=0..100))
colour_swatch = ColourSwatch(SwatchColor=RGB(245, 237, 250))
extrude = Extrude(Base=dispatch_4.ListA, Direction=simplify(unit_y_3))
unit_y_4 = UnitY(Factor=addition_2)
extrude_2 = Extrude(Base=dispatch_2.ListA, Direction=simplify(unit_y_4))
custom_preview = CustomPreview(Geometry=extrude, Material=colour_swatch)
custom_preview_2 = CustomPreview(Geometry=extrude_2, Material=colour_swatch)
merge = Merge(Data1=extrude_2, Data2=extrude)
